vi "Main Window.gvi"   [LabVIEW NXG 5.0.0]
panel controls:
  "Main Tab": i32
  "Light Calibration Tab": i32
  "Start Wavelength (nm)": f64 = 300
  "End Wavelength (nm)": f64 = 900
  "Wavelength Step (nm)": f64 = 5
  "New Calibration": bool
  "Load Calibration": bool
  "Save Calibration": bool
panel indicators:
  "Irradiance Calibration": f64[]
  "Light Power (W)": f64
  "Current Wavelength (nm)": f64
types:
  "Queue Instructions Control.gtype" = enum{"Undefined State", "Initialize App", "Idle"}
uses:
  NI::G Core::Error::Multiplex Errors.gvi
  NI::G Core::Error::Display Error.gvi
diagram:
  Obtain Queue(create if not found=TRUE, element data type="Queue Instructions Control.gtype" "Undefined State", name="Instruction Queue") -> (error out=w1, queue out=w2)
  s1 = w2  # shift register
  s2 = w1  # shift register
  while {
    # This is the consumer loop, it takes enqueued instructions and performs the ne required actions
    case (s2) {
      frame Error, Default {
        w3 = s2
        w4 = s1
      }
      frame No Error {
        Dequeue Element(error in=s2, queue=s1) -> (element=w5, error out=w6, queue out=w7)
        case (w5) {
          frame "Undefined State" {
            w3 = w6
            w4 = w7
          }
          frame "Idle", Default {
            w3 = w6
            w4 = w7
          }
          frame "Initialize App" {
            w3 = w6
            w4 = w7
          }
        }
      }
    }
    next s1 = w4
    next s2 = w3
    stop if w3
  }
  # This is the main window it takes instructions from the main pannel introduced by the user and
  # performs the corresponding necessary actions
  s3 = w2  # shift register
  s4 = w1  # shift register
  while {
    # This is the producer loop that takes the commands and if possible enqueues them so that the
    # slave loop can perform the corresponding actions
    event {
      on "Timeout" {
        w8 = s3
        w9 = s4
      }
    }
    next s3 = w8
    next s4 = w9
    stop if _
  }
  Flush Queue(error in=s4, queue=s3) -> (error out=w10, queue out=w11)
  Release Queue(error in=w10, queue=w11) -> (error out=w12)
  call "Multiplex Errors.gvi"(error in 1=s2, error in 2=w12) -> (error out=w13)
  case (w13) {
    frame Error, Default {
      # In case there is an error
      # put out an error handler
      call "Display Error.gvi"(error in=w13)
    }
    frame No Error { }
  }
